# Dynamo graph 0- Introduccion a Scripts Dynamo.dyn (Dynamo 1.3.3.4111)

code_block = CodeBlock()
# ---------- code_block.designscript (1 lines) ----------
"Con estos Scripts de Dynamo vamos a poder acelerar el flujo de trabajo, reduciendo tareas a minutos, facilitando herramientas de exportacion e importacion de datos y terminando un listado de planos en minutos. El modelado esta en trabajo para que sea mas facil pero todavia queda desarrollo de scripts con el modo de trabajo que tenemos en Iproma";
# ----------------------------------------
code_block_2 = CodeBlock { "Iproma | Arquitectura "; }
python_script = Python(IN[0]=code_block, IN[1]=code_block_2)
# ---------- python_script.python (15 lines) ----------
#This script pops up a dialog box with a message from the previous node.
import clr
clr.AddReference('RevitAPIUI')

from Autodesk.Revit.UI import TaskDialog

mainText = IN[0]
footerText = IN[1]

messagePop = TaskDialog("Dynamo Player")
messagePop.MainContent = mainText + "\n\n" + "<a href=\" https://iproma.com.ar \">" + footerText + "</a>";

OUT = "Success!"

messagePop.Show()
# ----------------------------------------
