# Dynamo graph Administration - Actualiza el nombre de Planos a mayuscula.dyn (Dynamo 1.3.3.4111)

# group: Update Sheet Names to Upper Case
# note: CATEGORY:
# Administration
# DESCRIPTION:
# This workflow sets the names of all Sheets in the model to UPPER CASE.
# MODEL PREPARATION:
# - None
# NOTE:
#  - None
# AUTHORS:
# - Autodesk
# Copyright(c) 2017, Autodesk
# REQUIRED PACKAGES:
# - None

element_types = ElementTypes("ViewSheet")
all_elements_of_type = ElementsOfType(element_types)
code_block = CodeBlock { "Sheet Name"; }
getParameterValueByName = Element.GetParameterValueByName(element=all_elements_of_type, parameterName=code_block)
toUpper = String.ToUpper(getParameterValueByName)
setParameterByName = Element.SetParameterByName(element=all_elements_of_type, parameterName=code_block, value=toUpper)
