# Dynamo graph Administration - Copy value Between Parameters.dyn (Dynamo 1.3.3.4111)

categories = Categories()
all_elements_of_category = ElementsOfCategory(categories)
code_block = CodeBlock { "Comments"; }
code_block_2 = CodeBlock { "Mark"; }
getParameterValueByName = Element.GetParameterValueByName(element=all_elements_of_category, parameterName=code_block_2)
setParameterByName = Element.SetParameterByName(element=all_elements_of_category, parameterName=code_block, value=getParameterValueByName)
