# Dynamo graph Administration - Delete Mark Values from ARQ-EST Content.dyn (Dynamo 1.3.3.4111)

categories = Categories("Walls")
categories_2 = Categories("Floors")
categories_3 = Categories("StructuralColumns")
categories_4 = Categories("StructuralFraming")
categories_5 = Categories("StructuralFoundation")
categories_6 = Categories("StairsRuns")
create = List.Create(categories, categories_2, categories_3, categories_4, categories_5, categories_6)
all_elements_of_category = ElementsOfCategory(create)
flatten = Flatten(all_elements_of_category)
string = StringInput("Mark")
string_2 = StringInput("")
setParameterByName = Element.SetParameterByName(element=flatten, parameterName=string, value=string_2)
