# Dynamo graph Administration - Delete Mark Values from MEP Content.dyn (Dynamo 1.3.3.4111)

categories = Categories("DuctTerminal")
categories_2 = Categories("DuctFitting")
categories_3 = Categories("DuctInsulations")
categories_4 = Categories("DuctLinings")
categories_5 = Categories("PlaceHolderDucts")
categories_6 = Categories("DuctCurves")
categories_7 = Categories("PipeFitting")
categories_8 = Categories("PipeInsulations")
categories_9 = Categories("PlaceHolderPipes")
categories_10 = Categories("MechanicalEquipment")
categories_11 = Categories("PlumbingFixtures")
categories_12 = Categories("ElectricalEquipment")
categories_13 = Categories("ElectricalFixtures")
categories_14 = Categories("CommunicationDevices")
categories_15 = Categories("ConduitFitting")
categories_16 = Categories("ConduitRun")
categories_17 = Categories("Conduit")
categories_18 = Categories("Wire")
categories_19 = Categories("LightingFixtures")
categories_20 = Categories("LightingDevices")
categories_21 = Categories("PipeCurves")
create = List.Create(categories, categories_2, categories_3, categories_4, categories_5, categories_6, categories_7, categories_8, categories_9, categories_10, categories_11, categories_12, categories_13, categories_14, categories_15, categories_16, categories_17, categories_18, categories_19, categories_20, categories_21)
all_elements_of_category = ElementsOfCategory(create)
flatten = Flatten(all_elements_of_category)
string = StringInput("Mark")
string_2 = StringInput("")
setParameterByName = Element.SetParameterByName(element=flatten, parameterName=string, value=string_2)
