# Dynamo graph Administration - Parametric.dyn (Dynamo 1.3.3.4111)

# group: ARQ-EST - MARK "null"
categories = Categories("Walls")
categories_2 = Categories("Floors")
categories_3 = Categories("StructuralColumns")
categories_4 = Categories("StructuralFraming")
categories_5 = Categories("StructuralFoundation")
categories_6 = Categories("StairsRuns")
create = List.Create(categories, categories_2, categories_3, categories_4, categories_5, categories_6)
all_elements_of_category = ElementsOfCategory(create)
flatten = Flatten(all_elements_of_category)
string = StringInput("Mark")
string_2 = StringInput("")
setParameterByName = Element.SetParameterByName(element=flatten, parameterName=string, value=string_2)

# group: TIPO - LADRILLO
selecciona_elementos_de_tipo = DSModelElementsSelection()  # "Selecciona elementos de TIPO-LADRILLO"
flatten_2 = Flatten(selecciona_elementos_de_tipo)
string_3 = StringInput("TIPO")
string_4 = StringInput("LADRILLO")
setParameterByName_2 = Element.SetParameterByName(element=flatten_2, parameterName=string_3, value=string_4)

# group: NO COMPUTA - EQUALS YES
seleccioná_elementos_que_no = DSModelElementsSelection()  # "Seleccioná elementos que NO COMPUTAN"
flatten_3 = Flatten(seleccioná_elementos_que_no)
string_5 = StringInput("NO COMPUTA")
boolean = BoolSelector(true)
setParameterByName_3 = Element.SetParameterByName(element=flatten_3, parameterName=string_5, value=boolean)
