# Dynamo graph Administration - Update Sheet Names to Lower Case.dyn (Dynamo 1.3.3.4111)

element_types = ElementTypes("ViewSheet")
all_elements_of_type = ElementsOfType(element_types)
code_block = CodeBlock { "Sheet Name"; }
getParameterValueByName = Element.GetParameterValueByName(element=all_elements_of_type, parameterName=code_block)
toLower = String.ToLower(getParameterValueByName)
setParameterByName = Element.SetParameterByName(element=all_elements_of_type, parameterName=code_block, value=toLower)
