# Dynamo graph Administration - Update View Names to Lower Case.dyn (Dynamo 1.3.3.4111)

# note: modifica los nombres de las visualizaciones a mayusculas
element_types = ElementTypes("View")
all_elements_of_type = ElementsOfType(element_types)
code_block = CodeBlock { "View Name"; }
getParameterValueByName = Element.GetParameterValueByName(element=all_elements_of_type, parameterName=code_block)
toLower = String.ToLower(getParameterValueByName)
setParameterByName = Element.SetParameterByName(element=all_elements_of_type, parameterName=code_block, value=toLower)
