# Dynamo graph Administration - Update View Names to Upper Case.dyn (Dynamo 1.3.3.4111)

# note: modifica los nombres de las visualizaciones a mayusculas
element_types = ElementTypes("View")
all_elements_of_type = ElementsOfType(element_types)
code_block = CodeBlock { "View Name"; }
getParameterValueByName = Element.GetParameterValueByName(element=all_elements_of_type, parameterName=code_block)
toUpper = String.ToUpper(getParameterValueByName)
setParameterByName = Element.SetParameterByName(element=all_elements_of_type, parameterName=code_block, value=toUpper)
