# Dynamo graph Annotate - Cotas Datum.dyn (Dynamo 1.3.3.4111)

# group: Acotar Grillas/Niveles
current = Document.Current()
activeView = Document.ActiveView(current)
select_model_elements = DSModelElementsSelection()  # 4 picked in the model
byElements = Dimension.ByElements(activeView, select_model_elements)
