# Dynamo graph 1 - Modeler - Columnas entre curvas.dyn (Dynamo 1.3.3.4111)

# group: PN-00n°
# note: Model Curves have been selected and their element IDs saved with this file
# note: Place Structural Column Relative to some elements selected from a Revit file
select_model_element_bottom = DSModelElementSelection()  # 1 picked in the model
geometry = Element.Geometry(select_model_element_bottom)
integer_slider = IntegerSlider(6, range=2..10 step 1)
code_block = CodeBlock(x=integer_slider) { 0..1..#x; }
pointAtParameter = Curve.PointAtParameter(curve=geometry, param=code_block, lacing=CrossProduct)
select_model_element_top = DSModelElementSelection()  # 1 picked in the model
# note: Geometry is Seperated from Revit Elements
geometry_2 = Element.Geometry(select_model_element_top)
# note: Create Points along the Lines
pointAtParameter_2 = Curve.PointAtParameter(curve=geometry_2, param=code_block, lacing=CrossProduct)
byStartPointEndPoint = Line.ByStartPointEndPoint(startPoint=pointAtParameter, endPoint=pointAtParameter_2)
flatten = Flatten(byStartPointEndPoint)
levels = Levels("ES-S/P00")
structural_column_types = StructuralColumnTypes("UPN 80")
# note: Place Structural Column
columnByCurve = StructuralFraming.ColumnByCurve(curve=flatten, level=levels, structuralColumnType=structural_column_types)
