# Dynamo graph 1 - Modeler - Multiples columnas.dyn (Dynamo 1.3.3.4111)

# group: PN-00n°
# note: Model Curves have been selected and their element IDs saved with this file
# note: Selecciona una Viga para emplazarle columnas en el medio
select_model_element_bottom = DSModelElementSelection()  # 1 picked in the model
select_model_element_top = DSModelElementSelection()  # 1 picked in the model
# note: Geometry is Seperated from Revit Elements
geometry = Element.Geometry()  # unwired: arg0
integer_slider = IntegerSlider(5, range=2..10 step 1)
code_block = CodeBlock(x=integer_slider) { 0..1..#x; }
# note: Create Points along the Lines
pointAtParameter = Curve.PointAtParameter(curve=geometry, param=code_block, lacing=CrossProduct)
geometry_2 = Element.Geometry()  # unwired: arg0
pointAtParameter_2 = Curve.PointAtParameter(curve=geometry_2, param=code_block, lacing=CrossProduct)
byStartPointEndPoint = Line.ByStartPointEndPoint(startPoint=pointAtParameter, endPoint=pointAtParameter_2)
flatten = Flatten(byStartPointEndPoint)
levels = Levels("ES-S/P00")
# note: Place Structural Column
columnByCurve = StructuralFraming.ColumnByCurve(curve=flatten, level=levels)  # unwired: structuralColumnType
structural_column_types = StructuralColumnTypes("UPN 160")
