# Dynamo graph 1 - Modeler - Vigas en curvas.dyn (Dynamo 1.3.3.4111)

# note: Run this graph the DynamoSample.rvt file in the Samples folder located with your Dynamo installation
# C:\ProgramData\Dynamo\Dynamo Revit\(Your Dynamo Version)\samples\Revit
# note: Place Structural Framing Relative to some elements selected from a Revit file
select_model_element = DSModelElementSelection()  # 1 picked in the model
geometry = Element.Geometry(select_model_element)
levels = Levels("ES-S/P00")
structural_framing_types = StructuralFramingTypes("VHA")
# note: Place Structural Framing
beamByCurve = StructuralFraming.BeamByCurve(curve=geometry, level=levels, structuralFramingType=structural_framing_types)
