# Dynamo graph 1 - Modeler - Vigas entre curvas.dyn (Dynamo 1.3.3.4111)

select_model_element = DSModelElementSelection()  # 1 picked in the model
geometry = Element.Geometry(select_model_element)
number_slider = DoubleSlider(6, range=0..10 step 0.5)
code_block = CodeBlock(x=number_slider) { 0..1..#x; }
pointAtParameter = Curve.PointAtParameter(curve=geometry, param=code_block, lacing=CrossProduct)
select_model_element_2 = DSModelElementSelection()  # 1 picked in the model
geometry_2 = Element.Geometry(select_model_element_2)
pointAtParameter_2 = Curve.PointAtParameter(curve=geometry_2, param=code_block, lacing=CrossProduct)
byStartPointEndPoint = Line.ByStartPointEndPoint(startPoint=pointAtParameter, endPoint=pointAtParameter_2)
flatten = Flatten(byStartPointEndPoint)
levels = Levels("ES-S/P00")
structural_framing_types = StructuralFramingTypes("VHA")
beamByCurve = StructuralFraming.BeamByCurve(curve=flatten, level=levels, structuralFramingType=structural_framing_types)
