# Dynamo graph 1 - Sheet  - Listado de laminas segun Excel.dyn (Dynamo 1.3.3.4111)

file_path = Filename("..\Listado de Planos - Dynamo.xlsx")
fromPath = FileObject(file_path)  # "File.FromPath"
code_block = CodeBlock { "Arquitectura"; }
readFromFile = Excel.ReadFromFile(file=fromPath, sheetName=code_block)
transpose = List.Transpose(readFromFile)
code_block_2 = CodeBlock { 0; 1; 2; }
getItemAtIndex = List.GetItemAtIndex(list=transpose, index=code_block_2.out1)
getItemAtIndex_2 = List.GetItemAtIndex(list=transpose, index=code_block_2.out0)
family_types = FamilyTypes("HOJAS IPROMA:A3")
getItemAtIndex_3 = List.GetItemAtIndex(list=transpose, index=code_block_2.out2)
byNameNumberTitleBlockAndView = Sheet.ByNameNumberTitleBlockAndView(sheetName=getItemAtIndex, sheetNumber=getItemAtIndex_2, titleBlockFamilyType=family_types, view=getItemAtIndex_3)
