# Dynamo graph Certificacion - BORRAR VALORES.dyn (Dynamo 1.3.3.4111)

selecciona_elementos_encofrados = DSModelElementsSelection()
flatten = Flatten(selecciona_elementos_encofrados)
string = StringInput("BARRAS DOBLADAS - CANT")
string_2 = StringInput("\"\"")
setParameterByName = Element.SetParameterByName(element=flatten, parameterName=string, value=string_2)
boolean = BoolSelector(false)
