# Dynamo graph Certificacion - Encofrado.dyn (Dynamo 1.3.3.4111)

selecciona_elementos_encofrados = DSModelElementsSelection()
flatten = Flatten(selecciona_elementos_encofrados)
string = StringInput("01-Encofrado")
boolean = BoolSelector(true)
setParameterByName = Element.SetParameterByName(element=flatten, parameterName=string, value=boolean)
