# Dynamo graph Modeler - Floors en base a room.dyn (Dynamo 1.3.3.4111)

# group: Pisos en base a Rooms
categories = Categories("Rooms")
all_elements_of_category = ElementsOfCategory(categories)
geometry = Element.Geometry(all_elements_of_category)
XY = Plane.XY()
intersectAll = Geometry.IntersectAll(geometry=geometry, others=XY)
perimeterCurves = Surface.PerimeterCurves(intersectAll)
code_block = CodeBlock { 2; }
flatten = List.Flatten(list=perimeterCurves, amt=code_block)
floor_types = FloorTypes("Floor 1")
levels = Levels("Level 1")
byOutlineTypeAndLevel = Floor.ByOutlineTypeAndLevel(outline=flatten, floorType=floor_types, level=levels)
