# Dynamo graph Modeler - Walls en base a room.dyn (Dynamo 1.3.3.4111)

categories = Categories("Rooms")
all_elements_of_category = ElementsOfCategory(categories)
geometry = Element.Geometry(all_elements_of_category)
XY = Plane.XY()
intersectAll = Geometry.IntersectAll(geometry=geometry, others=XY)
perimeterCurves = Surface.PerimeterCurves(intersectAll)
code_block = CodeBlock { 2; }
flatten = List.Flatten(list=perimeterCurves, amt=code_block)
levels = Levels("P00")
levels_2 = Levels("ES-S/P00")
wall_types = WallTypes("GEN 1.5/")
byCurveAndLevels = Wall.ByCurveAndLevels(flatten, levels, levels_2, wall_types)
