# Dynamo graph Schedule-Create.dyn (Dynamo 1.3.3.4111)

categoria = Categories("Walls")
nombre_de_la_tabla = CodeBlock { "Nombre"; }
tipo_de_tabla = ScheduleTypes("RegularSchedule")
createSchedule = ScheduleView.CreateSchedule(category=categoria, name=nombre_de_la_tabla, scheduleType=tipo_de_tabla)
schedulableFields = ScheduleView.SchedulableFields(createSchedule)
fields = CodeBlock(x=schedulableFields) { x[1]; x[12]; x[17]; x[33]; x[18]; x[41]; }
create = List.Create(fields.out0, fields.out1, fields.out2, fields.out3, fields.out4, fields.out5)
flatten = Flatten(create)
addFields = ScheduleView.AddFields(scheduleView=createSchedule, fields=flatten)
