# Dynamo graph Sheet - Export to DWFX.dyn (Dynamo 1.3.3.4111)

code_block = CodeBlock { "Sheets"; }
byName = Category.ByName(code_block)
all_elements_of_category = ElementsOfCategory(byName)
sheetNumber = Sheet.SheetNumber(all_elements_of_category)
sheetName = Sheet.SheetName(all_elements_of_category)
code_block_2 = CodeBlock(snu=sheetNumber, sna=sheetName) { snu + ": " + sna; }
directory_path = Directory("C:\Users\tecnica7\Desktop")
