# Dynamo graph Sheet - Export to PDF.dyn (Dynamo 1.3.3.4111)

code_block = CodeBlock { Views; }  # unwired: Views
string = StringInput("PrintRange")
boolean = BoolSelector(true)
code_block_2 = CodeBlock { "Sheets"; }
byName = Category.ByName(code_block_2)
all_elements_of_category = ElementsOfCategory(byName)
sheetNumber = Sheet.SheetNumber(all_elements_of_category)
sheetName = Sheet.SheetName(all_elements_of_category)
code_block_3 = CodeBlock(snu=sheetNumber, sna=sheetName) { snu + ": " + sna; }
directory_path = Directory("C:\Users\tecnica7\Desktop")
print_pdf = Custom[Print PDF](Views=code_block, PrintRange=string, CombinedFile=boolean, PrinterName=code_block_3, FilePath=directory_path)  # This node will allow you to initiate a printing routine in revit from a set of views/sheets, printer name, print settings and print range.; unwired: PrintSettings
