# Dynamo graph Sheet - Visualizaciones y Planos en Base a Nivel - 2.dyn (Dynamo 1.3.3.4111)

levels = Levels("P00")
byLevel = StructuralPlanView.ByLevel(levels)
string = StringInput("View Name")
visualizacion_2 = StringInput("")
setParameterByName = Element.SetParameterByName(element=byLevel, parameterName=string, value=visualizacion_2)
levels_2 = Levels("P00")
byLevel_2 = StructuralPlanView.ByLevel(levels_2)
string_2 = StringInput("View Name")
visualizacion_1 = StringInput("")
setParameterByName_2 = Element.SetParameterByName(element=byLevel_2, parameterName=string_2, value=visualizacion_1)
nombre_del_primer_plano = StringInput("")
numero_del_primer_plano = StringInput("")
family_types = FamilyTypes("HOJAS IPROMA:A3")
visualizacion_1_2 = StringInput("")
byNameNumberTitleBlockAndViews = Sheet.ByNameNumberTitleBlockAndViews(nombre_del_primer_plano, numero_del_primer_plano, family_types, visualizacion_1_2)
nombre_del_segundo_plano = StringInput("")
numero_del_segundo_plano = StringInput("")
family_types_2 = FamilyTypes("HOJAS IPROMA:A3")
visualizacion_2_2 = StringInput("")
byNameNumberTitleBlockAndViews_2 = Sheet.ByNameNumberTitleBlockAndViews(nombre_del_segundo_plano, numero_del_segundo_plano, family_types_2, visualizacion_2_2)
