# Dynamo graph Sheet - Visualizaciones y Planos en Base a Nivel - 4.dyn (Dynamo 1.3.3.4111)

levels = Levels("P00")
byLevel = StructuralPlanView.ByLevel(levels)
string = StringInput("View Name")
visualizacion_3 = StringInput("")
setParameterByName = Element.SetParameterByName(element=byLevel, parameterName=string, value=visualizacion_3)
levels_2 = Levels("P00")
byLevel_2 = StructuralPlanView.ByLevel(levels_2)
string_2 = StringInput("View Name")
visualizacion_4 = StringInput("")
setParameterByName_2 = Element.SetParameterByName(element=byLevel_2, parameterName=string_2, value=visualizacion_4)
levels_3 = Levels("P00")
byLevel_3 = StructuralPlanView.ByLevel(levels_3)
string_3 = StringInput("View Name")
visualizacion_2 = StringInput("")
setParameterByName_3 = Element.SetParameterByName(element=byLevel_3, parameterName=string_3, value=visualizacion_2)
levels_4 = Levels("P00")
byLevel_4 = StructuralPlanView.ByLevel(levels_4)
string_4 = StringInput("View Name")
visualizacion_1 = StringInput("")
setParameterByName_4 = Element.SetParameterByName(element=byLevel_4, parameterName=string_4, value=visualizacion_1)
nombre_del_primer_plano = StringInput("")
numero_del_primer_plano = StringInput("")
family_types = FamilyTypes("HOJAS IPROMA:A3")
visualizacion_1_2 = StringInput("")
byNameNumberTitleBlockAndViews = Sheet.ByNameNumberTitleBlockAndViews(nombre_del_primer_plano, numero_del_primer_plano, family_types, visualizacion_1_2)
nombre_del_segundo_plano = StringInput("")
numero_del_segundo_plano = StringInput("")
family_types_2 = FamilyTypes("HOJAS IPROMA:A3")
visualizacion_2_2 = StringInput("")
byNameNumberTitleBlockAndViews_2 = Sheet.ByNameNumberTitleBlockAndViews(nombre_del_segundo_plano, numero_del_segundo_plano, family_types_2, visualizacion_2_2)
nombre_del_tercer_plano = StringInput("")
numero_del_tercer_plano = StringInput("")
family_types_3 = FamilyTypes("HOJAS IPROMA:A3")
visualizacion_3_2 = StringInput("")
byNameNumberTitleBlockAndViews_3 = Sheet.ByNameNumberTitleBlockAndViews(nombre_del_tercer_plano, numero_del_tercer_plano, family_types_3, visualizacion_3_2)
nombre_del_cuarto_plano = StringInput("")
numero_del_cuarto_plano = StringInput("")
family_types_4 = FamilyTypes("HOJAS IPROMA:A3")
visualizacion_4_2 = StringInput("")
byNameNumberTitleBlockAndViews_4 = Sheet.ByNameNumberTitleBlockAndViews(nombre_del_cuarto_plano, numero_del_cuarto_plano, family_types_4, visualizacion_4_2)
