# Dynamo graph View - Visualizacion en base a Nivel - 10.dyn (Dynamo 1.3.3.4111)

# group: 10 VISUALIZACIONES
levels = Levels("P00")
byLevel = StructuralPlanView.ByLevel(levels)
string = StringInput("View Name")
string_2 = StringInput("")
setParameterByName = Element.SetParameterByName(element=byLevel, parameterName=string, value=string_2)
levels_2 = Levels("P00")
byLevel_2 = StructuralPlanView.ByLevel(levels_2)
string_3 = StringInput("View Name")
string_4 = StringInput("")
setParameterByName_2 = Element.SetParameterByName(element=byLevel_2, parameterName=string_3, value=string_4)
levels_3 = Levels("P00")
byLevel_3 = StructuralPlanView.ByLevel(levels_3)
string_5 = StringInput("View Name")
string_6 = StringInput("")
setParameterByName_3 = Element.SetParameterByName(element=byLevel_3, parameterName=string_5, value=string_6)
levels_4 = Levels("P00")
byLevel_4 = StructuralPlanView.ByLevel(levels_4)
string_7 = StringInput("View Name")
string_8 = StringInput("")
setParameterByName_4 = Element.SetParameterByName(element=byLevel_4, parameterName=string_7, value=string_8)
levels_5 = Levels("P00")
byLevel_5 = StructuralPlanView.ByLevel(levels_5)
string_9 = StringInput("View Name")
string_10 = StringInput("")
setParameterByName_5 = Element.SetParameterByName(element=byLevel_5, parameterName=string_9, value=string_10)
levels_6 = Levels("P00")
byLevel_6 = StructuralPlanView.ByLevel(levels_6)
string_11 = StringInput("View Name")
string_12 = StringInput("")
setParameterByName_6 = Element.SetParameterByName(element=byLevel_6, parameterName=string_11, value=string_12)
levels_7 = Levels("P00")
byLevel_7 = StructuralPlanView.ByLevel(levels_7)
string_13 = StringInput("View Name")
string_14 = StringInput("")
setParameterByName_7 = Element.SetParameterByName(element=byLevel_7, parameterName=string_13, value=string_14)
levels_8 = Levels("P00")
byLevel_8 = StructuralPlanView.ByLevel(levels_8)
string_15 = StringInput("View Name")
string_16 = StringInput("")
setParameterByName_8 = Element.SetParameterByName(element=byLevel_8, parameterName=string_15, value=string_16)
levels_9 = Levels("P00")
byLevel_9 = StructuralPlanView.ByLevel(levels_9)
string_17 = StringInput("View Name")
string_18 = StringInput("")
setParameterByName_9 = Element.SetParameterByName(element=byLevel_9, parameterName=string_17, value=string_18)
levels_10 = Levels("P00")
byLevel_10 = StructuralPlanView.ByLevel(levels_10)
string_19 = StringInput("View Name")
string_20 = StringInput("")
setParameterByName_10 = Element.SetParameterByName(element=byLevel_10, parameterName=string_19, value=string_20)
