# Dynamo graph View - Visualizacion en base a Nivel - 2.dyn (Dynamo 1.3.3.4111)

levels = Levels("P00")
byLevel = StructuralPlanView.ByLevel(levels)
string = StringInput("View Name")
string_2 = StringInput("")
setParameterByName = Element.SetParameterByName(element=byLevel, parameterName=string, value=string_2)
levels_2 = Levels("P00")
byLevel_2 = StructuralPlanView.ByLevel(levels_2)
string_3 = StringInput("View Name")
string_4 = StringInput("")
setParameterByName_2 = Element.SetParameterByName(element=byLevel_2, parameterName=string_3, value=string_4)
