# Dynamo graph View - Visualizacion en base a Nivel - 4.dyn (Dynamo 1.3.3.4111)

levels = Levels("P00")
byLevel = StructuralPlanView.ByLevel(levels)
string = StringInput("View Name")
string_2 = StringInput("")
setParameterByName = Element.SetParameterByName(element=byLevel, parameterName=string, value=string_2)
levels_2 = Levels("P00")
byLevel_2 = StructuralPlanView.ByLevel(levels_2)
string_3 = StringInput("View Name")
string_4 = StringInput("")
setParameterByName_2 = Element.SetParameterByName(element=byLevel_2, parameterName=string_3, value=string_4)
levels_3 = Levels("P00")
byLevel_3 = StructuralPlanView.ByLevel(levels_3)
string_5 = StringInput("View Name")
string_6 = StringInput("")
setParameterByName_3 = Element.SetParameterByName(element=byLevel_3, parameterName=string_5, value=string_6)
levels_4 = Levels("P00")
byLevel_4 = StructuralPlanView.ByLevel(levels_4)
string_7 = StringInput("View Name")
string_8 = StringInput("")
setParameterByName_4 = Element.SetParameterByName(element=byLevel_4, parameterName=string_7, value=string_8)
