# Dynamo graph Model - Walls by Curves.dyn (Dynamo 1.3.3.4111)

select_model_elements = DSModelElementsSelection()
geometry = Element.Geometry(select_model_elements)
levels = Levels("ES-S/P00")
levels_2 = Levels("ES-S/P01")
wall_types = WallTypes("GEN 21/")
byCurveAndLevels = Wall.ByCurveAndLevels(geometry, levels, levels_2, wall_types)
