# Dynamo graph Sheet - Armados de Planos - 01.dyn (Dynamo 1.3.3.4111)

nombre_del_primer_plano = StringInput("")
numeracion_del_primer_plano = StringInput("")
hoja_del_primer_plano = FamilyTypes("HOJAS IPROMA:A2")
primera_view_terminada = Views()
byNameNumberTitleBlockAndViews = Sheet.ByNameNumberTitleBlockAndViews(nombre_del_primer_plano, numeracion_del_primer_plano, hoja_del_primer_plano, primera_view_terminada)
