# Dynamo graph Sheet - Armados de Planos - 02.dyn (Dynamo 1.3.3.4111)

nombre_del_primer_plano = StringInput("")
numeracion_del_primer_plano = StringInput("")
hoja_del_primer_plano = FamilyTypes()
primera_view_terminada = Views()
byNameNumberTitleBlockAndViews = Sheet.ByNameNumberTitleBlockAndViews(nombre_del_primer_plano, numeracion_del_primer_plano, hoja_del_primer_plano, primera_view_terminada)
nombre_del_segundo_plano = StringInput("")
numeracion_del_segundo_plano = StringInput("")
hoja_del_segundo_plano = FamilyTypes()
segunda_view_terminada = Views()
byNameNumberTitleBlockAndViews_2 = Sheet.ByNameNumberTitleBlockAndViews(nombre_del_segundo_plano, numeracion_del_segundo_plano, hoja_del_segundo_plano, segunda_view_terminada)
