# Dynamo graph Sheet - Armados de Planos - 04.dyn (Dynamo 1.3.3.4111)

nombre_del_primer_plano = StringInput("")
numeracion_del_primer_plano = StringInput("")
hoja_del_primer_plano = FamilyTypes()
primera_view_terminada = Views()
byNameNumberTitleBlockAndViews = Sheet.ByNameNumberTitleBlockAndViews(nombre_del_primer_plano, numeracion_del_primer_plano, hoja_del_primer_plano, primera_view_terminada)
nombre_del_segundo_plano = StringInput("")
numeracion_del_segundo_plano = StringInput("")
hoja_del_segundo_plano = FamilyTypes()
segunda_view_terminada = Views()
byNameNumberTitleBlockAndViews_2 = Sheet.ByNameNumberTitleBlockAndViews(nombre_del_segundo_plano, numeracion_del_segundo_plano, hoja_del_segundo_plano, segunda_view_terminada)
nombre_del_tercer_plano = StringInput("")
numeracion_del_tercer_plano = StringInput("")
hoja_del_tercer_plano = FamilyTypes()
tercera_view_terminada = Views()
byNameNumberTitleBlockAndViews_3 = Sheet.ByNameNumberTitleBlockAndViews(nombre_del_tercer_plano, numeracion_del_tercer_plano, hoja_del_tercer_plano, tercera_view_terminada)
nombre_del_cuarto_plano = StringInput("")
numeracion_del_cuarto_plano = StringInput("")
hoja_del_cuarto_plano = FamilyTypes()
cuarta_view_terminada = Views()
byNameNumberTitleBlockAndViews_4 = Sheet.ByNameNumberTitleBlockAndViews(nombre_del_cuarto_plano, numeracion_del_cuarto_plano, hoja_del_cuarto_plano, cuarta_view_terminada)
