# Dynamo graph Structural - Exportar datos en Bases.dyn (Dynamo 1.3.3.4111)

# group: LO EXTERNO
file_path = Filename("C:\Users\tecnica7\Desktop\COLUMNAS PARAMETROS.xlsx")
code_block = CodeBlock { "Hoja1"; }
code_block_2 = CodeBlock { 0; }

# group: ELEMENTO
categories = Categories("StructuralColumns")
all_elements_of_category = ElementsOfCategory(categories)

code_block_3 = CodeBlock { {"Mark","LADO A COLUMNA","LADO B COLUMNA","ARMADURA COLUMNA","TRAMO ESTRIBOS"}; }
getParameterValueByName = Element.GetParameterValueByName(element=all_elements_of_category, parameterName=code_block_3, lacing=CrossProduct)

# group: ESTO ES PARA TENER EL EXCEL ABIERTO O NO
boolean = BoolSelector(true)

writeToFile = Excel.WriteToFile(filePath=file_path, sheetName=code_block, startRow=code_block_2, startCol=code_block_2, data=getParameterValueByName, overWrite=boolean)

# group: EN CASO DE SER VARIOS ELEMENTOS NECESARIOS, AGREGAR LISTA
create = List.Create()  # unwired: arg0
