# Dynamo graph Structural - Exportar datos en Columnas.dyn (Dynamo 1.3.3.4111)

# group: Ubicacion del excel y hoja
code_block = CodeBlock { "Hoja1"; }
code_block_2 = CodeBlock { 0; }
file_path = Filename("No file selected.")

# group: ELEMENTO
categories = Categories("StructuralColumns")
all_elements_of_category = ElementsOfCategory(categories)

code_block_3 = CodeBlock { {"Mark","LADO A COLUMNA","LADO B COLUMNA","ARMADURA COLUMNA","TRAMO ESTRIBOS"}; }
getParameterValueByName = Element.GetParameterValueByName(element=all_elements_of_category, parameterName=code_block_3, lacing=CrossProduct)

# group: ESTO ES PARA TENER EL EXCEL ABIERTO O NO
boolean = BoolSelector(true)

writeToFile = Excel.WriteToFile(sheetName=code_block, startRow=code_block_2, startCol=code_block_2, data=getParameterValueByName, overWrite=boolean)  # unwired: filePath

# group: EN CASO DE SER VARIOS ELEMENTOS NECESARIOS, AGREGAR LISTA
create = List.Create()  # unwired: arg0
