# Dynamo graph Structural - Exportar datos en Losas.dyn (Dynamo 1.3.3.4111)

# group: Ubicacion del Excel y hoja
file_path = Filename("No file selected.")
code_block = CodeBlock { "Hoja1"; }
code_block_2 = CodeBlock { 0; }

# group: ELEMENTO
categories = Categories("Floors")
all_elements_of_category = ElementsOfCategory(categories)

code_block_3 = CodeBlock()
# ---------- code_block_3.designscript (7 lines) ----------
{"id","Mark",
"Type",
"AD.SUP. IZQ. X","AD. SUP. IZQ. Y",
"ARMADURA X",
"ARMADURA Y",
"AD.SUP. DER. X","AD. SUP. DER. Y",
"ARMADURA REPARTICIÓN"};
# ----------------------------------------
getParameterValueByName = Element.GetParameterValueByName(element=all_elements_of_category, parameterName=code_block_3, lacing=CrossProduct)
boolean = BoolSelector(true)
writeToFile = Excel.WriteToFile(filePath=file_path, sheetName=code_block, startRow=code_block_2, startCol=code_block_2, data=getParameterValueByName, overWrite=boolean)
