# Dynamo graph Structural - Exportar datos en Vigas.dyn (Dynamo 1.3.3.4111)

# group: Ubicacion del Excel y hoja
file_path = Filename("No file selected.")
code_block = CodeBlock { "Hoja1"; }
code_block_2 = CodeBlock { 0; }

# group: ELEMENTO
categories = Categories("StructuralFraming")
all_elements_of_category = ElementsOfCategory(categories)

code_block_3 = CodeBlock()
# ---------- code_block_3.designscript (9 lines) ----------
{"Mark",
"ESPESOR VIGA",
"ALTURA VIGA",
"AD. SUP. IZQUIERDO",
"ARMADURA INFERIOR",
"ARMADURA SUPERIOR",
"AD. SUP. DERECHO",
"BARRAS DOBLADAS",
"TRAMO ESTRIBOS"};
# ----------------------------------------
getParameterValueByName = Element.GetParameterValueByName(element=all_elements_of_category, parameterName=code_block_3, lacing=CrossProduct)

# group: ESTO ES PARA TENER EL EXCEL ABIERTO O NO
boolean = BoolSelector(true)

writeToFile = Excel.WriteToFile(filePath=file_path, sheetName=code_block, startRow=code_block_2, startCol=code_block_2, data=getParameterValueByName, overWrite=boolean)

# group: EN CASO DE SER VARIOS ELEMENTOS NECESARIOS, AGREGAR LISTA
create = List.Create()  # unwired: arg0
