# Dynamo graph Structural - Importar datos en Bases.dyn (Dynamo 1.3.3.4111)

file_path = Filename(".\COLUMNAS PARAMETROS.xlsx")
fromPath = FileObject(file_path)  # "File.FromPath"
string = StringInput("Hoja1")
readFromFile = Excel.ReadFromFile(file=fromPath, sheetName=string)
restOfItems = List.RestOfItems(readFromFile)
code_block = CodeBlock { 2; }
getItemAtIndex = List.GetItemAtIndex(list=restOfItems, index=code_block)
categories = Categories("StructuralColumns")
all_elements_of_category = ElementsOfCategory(categories)
code_block_2 = CodeBlock { "TRAMO ESTRIBOS"; }
transpose = List.Transpose(restOfItems)
code_block_3 = CodeBlock { 4; }
getItemAtIndex_2 = List.GetItemAtIndex(list=transpose, index=code_block_3)
setParameterByName = Element.SetParameterByName(element=all_elements_of_category, parameterName=code_block_2, value=getItemAtIndex_2)
