# Dynamo graph Structural - Importar datos en Columnas.dyn (Dynamo 1.3.3.4111)

file_path = Filename("No file selected.")
fromPath = FileObject(file_path)  # "File.FromPath"
string = StringInput("Hoja1")
readFromFile = Excel.ReadFromFile(file=fromPath, sheetName=string)
restOfItems = List.RestOfItems(readFromFile)
code_block = CodeBlock { 2; }
getItemAtIndex = List.GetItemAtIndex(list=restOfItems, index=code_block)
categories = Categories("StructuralColumns")
all_elements_of_category = ElementsOfCategory(categories)
code_block_2 = CodeBlock { "LADO A COLUMNA"; }
transpose = List.Transpose(restOfItems)
code_block_3 = CodeBlock { 1; }
getItemAtIndex_2 = List.GetItemAtIndex(list=transpose, index=code_block_3)
setParameterByName = Element.SetParameterByName(element=all_elements_of_category, parameterName=code_block_2, value=getItemAtIndex_2)
categories_2 = Categories("StructuralColumns")
all_elements_of_category_2 = ElementsOfCategory(categories_2)
code_block_4 = CodeBlock { "LADO B COLUMNA"; }
code_block_5 = CodeBlock { 2; }
getItemAtIndex_3 = List.GetItemAtIndex(list=transpose, index=code_block_5)
setParameterByName_2 = Element.SetParameterByName(element=all_elements_of_category_2, parameterName=code_block_4, value=getItemAtIndex_3)
categories_3 = Categories("StructuralColumns")
all_elements_of_category_3 = ElementsOfCategory(categories_3)
code_block_6 = CodeBlock { "ARMADURA COLUMNA"; }
code_block_7 = CodeBlock { 3; }
getItemAtIndex_4 = List.GetItemAtIndex(list=transpose, index=code_block_7)
setParameterByName_3 = Element.SetParameterByName(element=all_elements_of_category_3, parameterName=code_block_6, value=getItemAtIndex_4)
categories_4 = Categories("StructuralColumns")
all_elements_of_category_4 = ElementsOfCategory(categories_4)
code_block_8 = CodeBlock { "TRAMO ESTRIBOS"; }
code_block_9 = CodeBlock { 4; }
getItemAtIndex_5 = List.GetItemAtIndex(list=transpose, index=code_block_9)
setParameterByName_4 = Element.SetParameterByName(element=all_elements_of_category_4, parameterName=code_block_8, value=getItemAtIndex_5)
