# Dynamo graph Structural - Importar datos en Losas.dyn (Dynamo 1.3.3.4111)

categories = Categories("Floors")
all_elements_of_category = ElementsOfCategory(categories)
code_block = CodeBlock { "AD. SUP. IZQ. X"; }
file_path = Filename("No file selected.")
fromPath = FileObject(file_path)  # "File.FromPath"
string = StringInput("Hoja1")
readFromFile = Excel.ReadFromFile(file=fromPath, sheetName=string)
restOfItems = List.RestOfItems(readFromFile)
transpose = List.Transpose(restOfItems)
code_block_2 = CodeBlock { 2; }
getItemAtIndex = List.GetItemAtIndex(list=transpose, index=code_block_2)
setParameterByName = Element.SetParameterByName(element=all_elements_of_category, parameterName=code_block, value=getItemAtIndex)
categories_2 = Categories("Floors")
all_elements_of_category_2 = ElementsOfCategory(categories_2)
code_block_3 = CodeBlock { "AD. SUP. IZQ. Y"; }
code_block_4 = CodeBlock { 3; }
getItemAtIndex_2 = List.GetItemAtIndex(list=transpose, index=code_block_4)
setParameterByName_2 = Element.SetParameterByName(element=all_elements_of_category_2, parameterName=code_block_3, value=getItemAtIndex_2)
categories_3 = Categories("Floors")
all_elements_of_category_3 = ElementsOfCategory(categories_3)
code_block_5 = CodeBlock { "ARMADURA X"; }
code_block_6 = CodeBlock { 4; }
getItemAtIndex_3 = List.GetItemAtIndex(list=transpose, index=code_block_6)
setParameterByName_3 = Element.SetParameterByName(element=all_elements_of_category_3, parameterName=code_block_5, value=getItemAtIndex_3)
categories_4 = Categories("Floors")
all_elements_of_category_4 = ElementsOfCategory(categories_4)
code_block_7 = CodeBlock { "ARMADURA Y"; }
code_block_8 = CodeBlock { 5; }
getItemAtIndex_4 = List.GetItemAtIndex(list=transpose, index=code_block_8)
setParameterByName_4 = Element.SetParameterByName(element=all_elements_of_category_4, parameterName=code_block_7, value=getItemAtIndex_4)
categories_5 = Categories("Floors")
all_elements_of_category_5 = ElementsOfCategory(categories_5)
code_block_9 = CodeBlock { "AD. SUP. DER. Y"; }
code_block_10 = CodeBlock { 7; }
getItemAtIndex_5 = List.GetItemAtIndex(list=transpose, index=code_block_10)
setParameterByName_5 = Element.SetParameterByName(element=all_elements_of_category_5, parameterName=code_block_9, value=getItemAtIndex_5)
categories_6 = Categories("Floors")
all_elements_of_category_6 = ElementsOfCategory(categories_6)
code_block_11 = CodeBlock { "AD. SUP. DER. X"; }
code_block_12 = CodeBlock { 6; }
getItemAtIndex_6 = List.GetItemAtIndex(list=transpose, index=code_block_12)
setParameterByName_6 = Element.SetParameterByName(element=all_elements_of_category_6, parameterName=code_block_11, value=getItemAtIndex_6)
categories_7 = Categories("Floors")
all_elements_of_category_7 = ElementsOfCategory(categories_7)
code_block_13 = CodeBlock { "ARMADURA REPARTICIÓN"; }
code_block_14 = CodeBlock { 8; }
getItemAtIndex_7 = List.GetItemAtIndex(list=transpose, index=code_block_14)
setParameterByName_7 = Element.SetParameterByName(element=all_elements_of_category_7, parameterName=code_block_13, value=getItemAtIndex_7)
