# Dynamo graph Structural - Importar datos en Vigas.dyn (Dynamo 1.3.3.4111)

file_path = Filename("No file selected.")
fromPath = FileObject(file_path)  # "File.FromPath"
string = StringInput("Hoja1")
readFromFile = Excel.ReadFromFile(file=fromPath, sheetName=string)
restOfItems = List.RestOfItems(readFromFile)
code_block = CodeBlock { 2; }
getItemAtIndex = List.GetItemAtIndex(list=restOfItems, index=code_block)
categories = Categories("StructuralFraming")
all_elements_of_category = ElementsOfCategory(categories)
code_block_2 = CodeBlock { "AD. SUP. IZQUIERDO"; }
transpose = List.Transpose(restOfItems)
code_block_3 = CodeBlock { 3; }
getItemAtIndex_2 = List.GetItemAtIndex(list=transpose, index=code_block_3)
setParameterByName = Element.SetParameterByName(element=all_elements_of_category, parameterName=code_block_2, value=getItemAtIndex_2)
categories_2 = Categories("StructuralFraming")
all_elements_of_category_2 = ElementsOfCategory(categories_2)
code_block_4 = CodeBlock { "ARMADURA INFERIOR"; }
code_block_5 = CodeBlock { 4; }
getItemAtIndex_3 = List.GetItemAtIndex(list=transpose, index=code_block_5)
setParameterByName_2 = Element.SetParameterByName(element=all_elements_of_category_2, parameterName=code_block_4, value=getItemAtIndex_3)
categories_3 = Categories("StructuralFraming")
all_elements_of_category_3 = ElementsOfCategory(categories_3)
code_block_6 = CodeBlock { "ARMADURA SUPERIOR"; }
code_block_7 = CodeBlock { 5; }
getItemAtIndex_4 = List.GetItemAtIndex(list=transpose, index=code_block_7)
setParameterByName_3 = Element.SetParameterByName(element=all_elements_of_category_3, parameterName=code_block_6, value=getItemAtIndex_4)
categories_4 = Categories("StructuralFraming")
all_elements_of_category_4 = ElementsOfCategory(categories_4)
code_block_8 = CodeBlock { "AD. SUP. DERECHO"; }
code_block_9 = CodeBlock { 6; }
getItemAtIndex_5 = List.GetItemAtIndex(list=transpose, index=code_block_9)
setParameterByName_4 = Element.SetParameterByName(element=all_elements_of_category_4, parameterName=code_block_8, value=getItemAtIndex_5)
categories_5 = Categories("StructuralFraming")
all_elements_of_category_5 = ElementsOfCategory(categories_5)
code_block_10 = CodeBlock { "BARRAS DOBLADAS"; }
code_block_11 = CodeBlock { 7; }
getItemAtIndex_6 = List.GetItemAtIndex(list=transpose, index=code_block_11)
setParameterByName_5 = Element.SetParameterByName(element=all_elements_of_category_5, parameterName=code_block_10, value=getItemAtIndex_6)
categories_6 = Categories("StructuralFraming")
all_elements_of_category_6 = ElementsOfCategory(categories_6)
code_block_12 = CodeBlock { "TRAMO ESTRIBOS"; }
code_block_13 = CodeBlock { 8; }
getItemAtIndex_7 = List.GetItemAtIndex(list=transpose, index=code_block_13)
setParameterByName_6 = Element.SetParameterByName(element=all_elements_of_category_6, parameterName=code_block_12, value=getItemAtIndex_7)
categories_7 = Categories("StructuralFraming")
all_elements_of_category_7 = ElementsOfCategory(categories_7)
code_block_14 = CodeBlock { "ALTURA VIGA"; }
code_block_15 = CodeBlock { 2; }
getItemAtIndex_8 = List.GetItemAtIndex(list=transpose, index=code_block_15)
setParameterByName_7 = Element.SetParameterByName(element=all_elements_of_category_7, parameterName=code_block_14, value=getItemAtIndex_8)
categories_8 = Categories("StructuralFraming")
all_elements_of_category_8 = ElementsOfCategory(categories_8)
code_block_16 = CodeBlock { "ESPESOR VIGA"; }
code_block_17 = CodeBlock { 1; }
getItemAtIndex_9 = List.GetItemAtIndex(list=transpose, index=code_block_17)
setParameterByName_8 = Element.SetParameterByName(element=all_elements_of_category_8, parameterName=code_block_16, value=getItemAtIndex_9)
